# Grasshopper definition Kinect2RhinoFilter.gh (Grasshopper 0.8.66)

str = String("data\snap3.csv")
point_reduction = Slider(50, range=1..1000)
depth_scaling = Slider(4.369, range=1..20)
file = ReadFile(Path=str, Lines=True)
series = Series(Start=1, Step=2, Count=point_reduction)
bool = Boolean(False)
pt = Point(file)
bool_2 = Boolean(True)
ins = ListInsert(List=bool_2, Item=bool, Indices=flatten(series), Wrap=True)
cull = CullPattern(List=pt, CullPattern=ins)
lng = ListLength(List=cull)
division = Division(A=lng, B=1000000)  # -> flatten(Result)
# MegaPixels
panel = Panel(division)
pt_2 = Point(cull)
vcomp = Decompose(Vector=pt_2)  # -> XComponent, YComponent, ZComponent
multiplication = Multiplication(A=vcomp.XComponent, B=-1)
multiplication_2 = Multiplication(A=vcomp.YComponent, B=-1)
multiplication_3 = Multiplication(A=vcomp.ZComponent, B=depth_scaling)
vec = VectorXYZ(XComponent=multiplication_3, YComponent=multiplication, ZComponent=multiplication_2)  # -> Vector, Length
pt_3 = Point(vec.Vector)
prox = Proximity3D(Points=pt_3, Group=5, MaxRadius=Slider(20, range=0..100))  # -> Links, Topology
